# Grasshopper definition create_building.gh (Grasshopper 1.0.8)
# plug-ins: jSwan, Swiftlet

define_tool_parameter = DefineToolParameter(Name="degree", Type="number", Description="rotation degree", Required=True)
define_tool_parameter_2 = DefineToolParameter(Name="site_area", Type="number", Description="area of the building", Required=True)
define_tool_parameter_3 = DefineToolParameter(Name="width", Type="number", Description="width of the building", Required=True)
define_tool_parameter_4 = DefineToolParameter(Name="number_of_floors", Type="integer", Description="building 's number of floors", Required=True)
define_tool_parameter_5 = DefineToolParameter(Name="floor_height", Type="number", Description="floor height", Required=True)
define_tool_parameter_6 = DefineToolParameter(Name="add", Type="boolean", Description="add emergency exits to the building", Required=True)
merge = Merge(
    Data1=define_tool_parameter_2,
    Data2=define_tool_parameter_3,
    Data3=define_tool_parameter_4,
    Data4=define_tool_parameter_5)
define_tool = DefineTool(
    Name="rotate_building_toward_sunny_direction",
    Description="rotate_building_toward_sunny_direction",
    Parameters=define_tool_parameter)
define_tool_2 = DefineTool(Name="add_emergency_exits", Description="add_emergency_exits", Parameters=define_tool_parameter_6)
define_tool_3 = DefineTool(Name="create_building", Description="create a box-like building", Parameters=merge)
merge_2 = Merge(Data1=define_tool_3, Data2=define_tool_2, Data3=define_tool)
mcp_server = MCPServer(Port="5001", Tools=merge_2, ServerName="MCP")  # -> Add_emergency_exits, Create_building, Rotate_building_toward_sunny_direction
deconstruct_tool_call = DeconstructToolCall(Request=mcp_server.Create_building)  # -> Request, Tool, Arguments
panel = Panel("""{
  "id": 1,
  "method": "tools/list",
  "params": {}
}""")
deconstruct_tool_call_2 = DeconstructToolCall(Request=mcp_server.Add_emergency_exits)  # -> Request, Tool, Arguments
data_recorder = DataRecorder(deconstruct_tool_call.Arguments, DataLimit=-10, RecordData=True)
deconstruct_tool_call_3 = DeconstructToolCall(Request=mcp_server.Rotate_building_toward_sunny_direction)  # -> Request, Tool, Arguments
clean_tree = CleanTree(RemoveNulls=True, RemoveInvalid=True, RemoveEmpty=False, Tree=data_recorder)
create_text_body_custom = CreateTextBodyCustom(Content=panel, ContentType="application/json")
get_json_object_key = GetJSONObjectKey(JObject=deconstruct_tool_call_2.Arguments, Key="add")
get_json_object_key_2 = GetJSONObjectKey(JObject=deconstruct_tool_call_3.Arguments, Key="degree")
list_item = ListItem(List=clean_tree, Index=0, Wrap=True)  # -> Item1, Item
read_json_value = ReadJSONValue(JValue=get_json_object_key)  # -> AsString, AsNumber, AsBool
get_json_object_key_3 = GetJSONObjectKey(JObject=list_item.Item1, Key="floor_height")
get_json_object_key_4 = GetJSONObjectKey(JObject=list_item.Item1, Key="site_area")
get_json_object_key_5 = GetJSONObjectKey(JObject=list_item.Item1, Key="width")
get_json_object_key_6 = GetJSONObjectKey(JObject=list_item.Item1, Key="number_of_floors")
read_json_value_2 = ReadJSONValue(JValue=get_json_object_key_2)  # -> AsString, AsNumber, AsBool
post_request = POSTRequest(URL="http://localhost:5001/mcp", Body=create_text_body_custom, TimeoutSeconds=100)  # -> Status, Content, Response
deserialize_json = DeserializeJson(JSON=post_request.Content, OutputsLocked=False)  # -> Jsonrpc, Id, Result
deserialize_json_2 = DeserializeJson(JSON=deserialize_json.Result, OutputsLocked=False)
deserialize_json_3 = DeserializeJson(JSON=deserialize_json_2, OutputsLocked=False)  # -> Name, Description, InputSchema
read_json_value_3 = ReadJSONValue(JValue=get_json_object_key_3)  # -> AsString, AsNumber, AsBool
read_json_value_4 = ReadJSONValue(JValue=get_json_object_key_4)  # -> AsString, AsNumber, AsBool
read_json_value_5 = ReadJSONValue(JValue=get_json_object_key_5)  # -> AsString, AsNumber, AsBool
read_json_value_6 = ReadJSONValue(JValue=get_json_object_key_6)  # -> AsString, AsNumber, AsBool
panel_2 = Panel(post_request.Content)
panel_3 = Panel(deserialize_json_3.Name)
division = Division(A=read_json_value_4.AsNumber, B=read_json_value_5.AsNumber)
multiplication = Multiplication(A=read_json_value_6.AsNumber, B=read_json_value_3.AsNumber)
construct_domain = ConstructDomain(DomainStart=0, DomainEnd=read_json_value_5.AsNumber)
construct_domain_2 = ConstructDomain(DomainStart=0, DomainEnd=division)
construct_domain_3 = ConstructDomain(DomainStart=0, DomainEnd=multiplication)
stack_data = StackData(Data=read_json_value_3.AsNumber, Stack=read_json_value_6.AsNumber)
unit_y = UnitY(Factor=1)
unit_x = UnitX(Factor=1)
domain_box = DomainBox(Base=PlaneXY(0, 0, 0), X=construct_domain, Y=construct_domain_2, Z=construct_domain_3)
volume = Volume(Geometry=domain_box)  # -> Volume, Centroid
rotate = Rotate(Geometry=domain_box, Angle=degrees(read_json_value_2.AsNumber), Plane=volume.Centroid)  # -> Geometry, Transform
stream_filter = StreamFilter(Gate=read_json_value.AsBool, Stream1=domain_box)
deconstruct_box = DeconstructBox(Box=rotate.Geometry)  # -> Plane, X, Y, Z
deconstruct_brep = DeconstructBrep(Brep=stream_filter)  # -> Faces, Edges, Vertices
deconstruct_plane = DeconstructPlane(Plane=deconstruct_box.Plane)  # -> Origin, XAxis, YAxis, ZAxis
deconstruct_plane_2 = DeconstructPlane(Plane=deconstruct_brep.Faces)  # -> Origin, XAxis, YAxis, ZAxis
contour_ex = ContourEx(Shape=domain_box, Plane=PlaneXY(0, 0, 0), Distances=stack_data)
division_2 = Division(A=read_json_value_5.AsNumber, B=division)
multiplication_2 = Multiplication(A=division, B=read_json_value_5.AsNumber, C=read_json_value_6.AsNumber)
dot_product = DotProduct(VectorA=deconstruct_plane_2.ZAxis, VectorB=unit_x, Unitize=invert(False))
unit_z = UnitZ(Factor=1)
cross_product = CrossProduct(VectorA=deconstruct_plane.YAxis, VectorB=unit_z, Unitize=invert(False))  # -> Vector, Length
angle = Angle(VectorA=deconstruct_plane.YAxis, VectorB=unit_y)  # -> Angle, Reflex
equality = Equality(FirstNumber=dot_product, SecondNumber="1")  # -> Equality, Inequality
create_json_value = CreateJSONValue(Value=read_json_value_5.AsNumber)
create_json_value_2 = CreateJSONValue(Value=division)
create_json_value_3 = CreateJSONValue(Value=read_json_value_3.AsNumber)
create_json_value_4 = CreateJSONValue(Value=division_2)
create_json_value_5 = CreateJSONValue(Value=multiplication_2)
cull_pattern = CullPattern(List=deconstruct_brep.Faces, CullPattern=equality.Equality)
dot_product_2 = DotProduct(VectorA=unit_y, VectorB=cross_product.Vector, Unitize=invert(False))
degrees = Degrees(Radians=angle.Angle)
create_json_value_6 = CreateJSONValue(Value=read_json_value.AsBool)
absolute = Absolute(Value=dot_product_2)
panel_4 = Panel("""width
depth
height
ratio_constraint
gross_floor_area""")
merge_3 = Merge(
    Data1=create_json_value,
    Data2=create_json_value_2,
    Data3=create_json_value_3,
    Data4=create_json_value_4,
    Data5=create_json_value_5)
md_slider = MDSlider(
    SliderMode=0,
    slider_value=Point(0.4323626262, 0, 0.5),
    x_domain=Domain(0, 1),
    y_domain=Domain(0, 1),
    z_domain=Domain(0, 1))
evaluate_surface = EvaluateSurface(Surface=reparameterize(cull_pattern), Point=md_slider)  # -> Point, Normal, UDirection, VDirection, Frame
create_json_object = CreateJSONObject(Keys="is_emergency_exits_added", Values=create_json_value_6)
division_3 = Division(A=dot_product_2, B=absolute)
multiplication_3 = Multiplication(A=degrees, B=division_3)
create_json_value_7 = CreateJSONValue(Value=multiplication_3)
create_json_object_2 = CreateJSONObject(Keys="current_building_angle", Values=create_json_value_7)
create_json_object_3 = CreateJSONObject(Keys=panel_4, Values=merge_3)
mcp_tool_response = MCPToolResponse(Request=deconstruct_tool_call_2.Request, Content=create_json_object, IsError=False)
mcp_tool_response_2 = MCPToolResponse(Request=deconstruct_tool_call_3.Request, Content=create_json_object_2, IsError=False)
mcp_tool_response_3 = MCPToolResponse(Request=deconstruct_tool_call.Request, Content=create_json_object_3, IsError=False)
construct_domain_4 = ConstructDomain(DomainStart=0, DomainEnd=Slider(2.6, range=0..10))
construct_domain_5 = ConstructDomain(DomainStart=0, DomainEnd=Slider(2.5, range=0..10))
yz_plane = YZPlane(Origin=evaluate_surface.Point)
data_recorder_2 = DataRecorder(mcp_tool_response, DataLimit=-10, RecordData=True)
data_recorder_3 = DataRecorder(mcp_tool_response_2, DataLimit=-10, RecordData=True)
panel_5 = Panel(mcp_tool_response_3)
panel_6 = Panel(data_recorder_2)
rectangle = Rectangle(Plane=yz_plane, XSize=construct_domain_4, YSize=construct_domain_5, Radius=0)  # -> Rectangle, Length
panel_7 = Panel(data_recorder_3)
boundary_surfaces = BoundarySurfaces(Edges=rectangle.Rectangle)
custom_preview = CustomPreview(
    Geometry=boundary_surfaces,
    Material={diffuse=RGB(221, 160, 221), emission=RGB(66, 48, 66), shine=0.5, specular=RGB(255, 255, 255), transparency=0})
