# Grasshopper definition draw_box.gh (Grasshopper 1.0.8)
# plug-ins: jSwan, Swiftlet

define_tool_parameter = DefineToolParameter(Name="floor_height", Type="number", Description="floor height", Required=True)
define_tool_parameter_2 = DefineToolParameter(Name="area", Type="number", Description="area of the building", Required=True)
define_tool_parameter_3 = DefineToolParameter(Name="width", Type="number", Description="width of the building", Required=True)
define_tool_parameter_4 = DefineToolParameter(Name="number_of_floors", Type="integer", Description="building 's number of floors", Required=True)
merge = Merge(Data1=define_tool_parameter_2, Data2=define_tool_parameter_3, Data3=define_tool_parameter_4, Data4=define_tool_parameter)
define_tool_parameter_5 = DefineToolParameter(Name="floor_height", Type="number", Description="floor height", Required=True)
define_tool = DefineTool(Name="draw_box", Description="draw_box", Parameters=merge)
define_tool_2 = DefineTool(Name="run_csharp_script", Description="run_csharp_script")
mcp_server = MCPServer(Port="5001", Tools=define_tool, ServerName="MCP")
deconstruct_tool_call = DeconstructToolCall(Request=mcp_server)  # -> Request, Tool, Arguments
panel = Panel("""{
  "id": 1,
  "method": "tools/list",
  "params": {}
}""")
get_json_object_key = GetJSONObjectKey(JObject=deconstruct_tool_call.Arguments, Key="floor_height")
get_json_object_key_2 = GetJSONObjectKey(JObject=deconstruct_tool_call.Arguments, Key="area")
get_json_object_key_3 = GetJSONObjectKey(JObject=deconstruct_tool_call.Arguments, Key="width")
get_json_object_key_4 = GetJSONObjectKey(JObject=deconstruct_tool_call.Arguments, Key="number_of_floors")
create_text_body_custom = CreateTextBodyCustom(Content=panel, ContentType="application/json")
read_json_value = ReadJSONValue(JValue=get_json_object_key)  # -> AsString, AsNumber, AsBool
read_json_value_2 = ReadJSONValue(JValue=get_json_object_key_2)  # -> AsString, AsNumber, AsBool
read_json_value_3 = ReadJSONValue(JValue=get_json_object_key_3)  # -> AsString, AsNumber, AsBool
read_json_value_4 = ReadJSONValue(JValue=get_json_object_key_4)  # -> AsString, AsNumber, AsBool
post_request = POSTRequest(URL="http://localhost:5001/mcp", Body=create_text_body_custom, TimeoutSeconds=100)  # -> Status, Content, Response
deserialize_json = DeserializeJson(JSON=post_request.Content, OutputsLocked=False)  # -> Jsonrpc, Id, Result
deserialize_json_2 = DeserializeJson(JSON=deserialize_json.Result, OutputsLocked=False)
deserialize_json_3 = DeserializeJson(JSON=deserialize_json_2, OutputsLocked=False)  # -> Name, Description, InputSchema
division = Division(A=read_json_value_2.AsNumber, B=read_json_value_3.AsNumber)
multiplication = Multiplication(A=read_json_value_4.AsNumber, B=read_json_value.AsNumber)
panel_2 = Panel(post_request.Content)
panel_3 = Panel(deserialize_json_3.Name)
center_box = CenterBox(Base=PlaneXY(0, 0, 0), X=read_json_value_3.AsNumber, Y=division, Z=multiplication)
volume = Volume(Geometry=center_box)  # -> Volume, Centroid
panel_4 = Panel("""width
length
height
volume""")
create_json_value = CreateJSONValue(Value=read_json_value_3.AsNumber)
create_json_value_2 = CreateJSONValue(Value=read_json_value_4.AsNumber)
create_json_value_3 = CreateJSONValue(Value=read_json_value.AsNumber)
create_json_value_4 = CreateJSONValue(Value=volume.Volume)
merge_2 = Merge(Data1=create_json_value, Data2=create_json_value_2, Data3=create_json_value_3, Data4=create_json_value_4)
create_json_object = CreateJSONObject(Keys=panel_4, Values=merge_2)
mcp_tool_response = MCPToolResponse(Request=deconstruct_tool_call.Request, Content=create_json_object, IsError=False)
panel_5 = Panel(mcp_tool_response)
